# Grasshopper definition testBrepEnvi.gh (Grasshopper 0.9.76)
# plug-ins: Physarealm

brep = Brep(<brep referenced from the Rhino model>)
point = Point([<point referenced from the Rhino model> x2])
brep_2 = Brep(<brep referenced from the Rhino model>)
point_2 = Point([<point referenced from the Rhino model> x5])
brep_environment = BrepEnvironment(XResolution=100, YResolution=100, ZResolution=100, Brep=brep)  # -> Environment, Pts
point_emitter = PointEmitter(Points=point)
points_food = PointsFood(Points=point_2)
initial_population_setting = InitialPopulationSetting(PopulationSize=200)
timer = Timer(TimerInterval=200, Target=physarealm)  # disabled
number_slider = Slider(0.8, range=0..1)
number_slider_2 = Slider(1, range=0..10)
trail_setting = TrailSetting(AgentFoodTrailRatio=Slider(0.5, range=0..1))
physarealm = Physarealm(
    Environment=brep_environment.Environment,
    Emitter=point_emitter,
    Food=points_food,
    Settings=[initial_population_setting, trail_setting],
    Reset=Toggle(False))  # -> ChemoAttractorField, Population, Iteration
population_position = PopulationPosition(Population=physarealm.Population)
panel = Panel(physarealm.Population)
panel_2 = Panel(physarealm.Iteration)
population_interconnect = PopulationInterconnect(
    Population=physarealm.Population,
    Environment=physarealm.ChemoAttractorField,
    DetectRadius=number_slider_2,
    SelectPossibility=number_slider)  # disabled
field_interconnect = FieldInterconnect(
    Field=physarealm.ChemoAttractorField,
    Radius=number_slider_2,
    Possibility=number_slider,
    NearLevel=Slider(0.99, range=0..1))  # -> ConnectLine, ConnectWeight; disabled
c_script = CSharpScript()  # -> out, lines, weights; inputs nums: list of Double
# ---------- c_script: C# ----------
    int count = 0;
    List<Line> retLine = new List<Line>();
    List<double> weight = new List<double>();
    for(int k = 0; k < 40; k++){
      for(int j = 0; j < 40; j++)
      {
        for(int i = 0; i < 40; i++){
          param[i, j, k] = nums[count];
          count++;
        }
      }
    }

    for(int k = 0; k < 40; k++){
      for(int j = 0; j < 40; j++)
      {
        for(int i = 0; i < 40; i++){
          if(rd.NextDouble() > param[i, j, k] * 0.8)
            continue;
          Point3d thispt = new Point3d(i, j, k);
          List<Point3d> neighbor = findNeighborParticle(i, j, k, 1, 0.0002);
          foreach(Point3d pt in neighbor){
            if(rd.NextDouble() < param[i, j, k]/2){
              retLine.Add(new Line(pt, thispt));
              weight.Add(param[i, j, k] + param[(int) pt.X, (int) pt.Y, (int) pt.Z]);
            }
          }
        }
      }
    }
    lines = retLine;
    weights = weight;
# ---------- c_script: C# additional code ----------
  double[,,] param = new double[40, 40, 40];
  int _x = 40;
  int _y = 40;
  int _z = 40;
  Random rd = new Random();

  public List<Point3d> findNeighborParticle(int x, int y, int z, int radius, double near_level)
  {
    List<Point3d> nei = new List<Point3d>();
    int start_x = x - radius > 0 ? x - radius : 0;
    int start_y = y - radius > 0 ? y - radius : 0;
    int start_z = z - radius > 0 ? z - radius : 0;
    int end_x = x + radius <= _x - 1 ? x + radius : _x - 1;
    int end_y = y + radius <= _y - 1 ? y + radius : _y - 1;
    int end_z = z + radius <= _z - 1 ? z + radius : _z - 1;
    for (int i = start_x; i <= end_x; i++)
    {
      for (int j = start_y; j <= end_y; j++)
      {
        for (int k = start_z; k <= end_z; k++)
        {
          if (param[i, j, k] - param[x, y, z] < near_level)
            nei.Add(new Point3d(i, j, k));
        }
      }
    }

    return nei;
  }
# ---------- end c_script ----------
c_script_2 = CSharpScript(Reference="D:\研\上\STUDIO\1024SLIMEMOLDALGOINRHINO\PHYSARUMTEST-RHINO\PhysarumLib.dll")  # -> out, eva_mesh, trail, connect_lines; inputs particle_pos: list of Point3d, analysis_z: Int32, trail_out: Boolean
# ---------- c_script_2: C# ----------
    Grid3d mygrid = Grid as Grid3d;
    List<Line> connect = new List<Line>();
    //Mesh evaMesh = new Mesh();
    foreach(Point3d pt in particle_pos)
    {
      List<Point3d> nei = mygrid.findNeighborParticle((int) pt.X, (int) pt.Y, (int) pt.Z, 2);
      foreach(Point3d pt_nei in nei)
      {
        connect.Add(new Line(pt_nei, pt));
      }
    }

    //evaMesh = mygrid.getTrailEvaMesh(analysis_z);
    //eva_mesh = evaMesh;
    if(trail_out)
      trail = mygrid.getTrailV();
    connect_lines = connect;
# ---------- end c_script_2 ----------
